# Grasshopper definition HeathGH.gh (Grasshopper 1.0.8)

file_path = FilePath()
loadobjects = HBLoadObjects(hb_file=file_path, load=Toggle(True))  # -> out, hb_objs; plug-in component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
vizbytype = HBVisualizeByType(hb_objs=loadobjects.hb_objs)  # -> walls, interior_walls, roofs, ceilings, exterior_floors, interior_floors, air_walls, apertures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; plug-in component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
